# Dynamo graph 建具表取付場所入力自動化.dyn "251118_建具表取付場所入力自動化_修正中" (Dynamo 2.19.3.6394)

# group: レベルとカテゴリーを選択して、そこにあるすべてのカテゴリーを抽出する。
# 説明<グループの説明を編集するにはここをダブル クリック>
levels = Levels("2FL")  # graph input
python_script = Python(IN[0]=levels)  # CPython3
# ---------- python_script.python (135 lines) ----------
# -*- coding: utf-8 -*-
# Revit 2024 / Dynamo Python (CPython3)

import clr

# Dynamo ⇔ Revit ドキュメント
clr.AddReference("RevitServices")
from RevitServices.Persistence import DocumentManager
doc = DocumentManager.Instance.CurrentDBDocument

# Revit API
clr.AddReference("RevitAPI")
from Autodesk.Revit.DB import (
    FilteredElementCollector, ElementId,
    ViewPlan, ViewType, Level,
    BuiltInCategory
)

# Dynamo ラッパー対応
def _try_import_unwrap():
    try:
        clr.AddReference("RevitNodes")
        import Revit
        clr.ImportExtensions(Revit.Elements)
        return True
    except:
        return False

_HAS_UNWRAP = _try_import_unwrap()

def unwrap(x):
    if x is None:
        return None
    if _HAS_UNWRAP:
        try:
            return UnwrapElement(x)
        except:
            pass
    try:
        ie = getattr(x, "InternalElement", None)
        return ie if ie is not None else x
    except:
        return x

# ---------------------------
# 入力：IN[0] = レベル
#   Level / ElementId / int / 名前文字列 のどれでも可
# ---------------------------
lvl_in = IN[0] if len(IN) > 0 else None

def resolve_level_id(value):
    """レベル入力を ElementId に正規化"""
    if value is None:
        return None
    v = unwrap(value)

    # Level 要素
    if isinstance(v, Level):
        return v.Id

    # ElementId そのもの
    if isinstance(v, ElementId):
        return v

    # 数値ID
    if isinstance(v, int):
        return ElementId(v)

    # 名前文字列（大文字小文字無視）
    if isinstance(v, str):
        name_lc = v.strip().lower()
        for lv in FilteredElementCollector(doc).OfClass(Level).WhereElementIsNotElementType():
            if lv.Name.lower() == name_lc:
                return lv.Id
        return None

    return None

level_id = resolve_level_id(lvl_in)

# カテゴリ（部屋・ドア）
cats = doc.Settings.Categories
room_cat = cats.get_Item(BuiltInCategory.OST_Rooms)
door_cat = cats.get_Item(BuiltInCategory.OST_Doors)

def categories_visible(v):
    """ビューで部屋・ドアカテゴリが非表示でないか"""
    try:
        if v.GetCategoryHidden(room_cat.Id):
            return False
        if v.GetCategoryHidden(door_cat.Id):
            return False
        return True
    except:
        return False

candidate = None

if level_id:
    # 1) すべての ViewPlan を取得
    viewplans = (FilteredElementCollector(doc)
                 .OfClass(ViewPlan)
                 .WhereElementIsNotElementType()
                 .ToElements())

    valid = []

    for v in viewplans:
        # ビューテンプレートは除外
        if v.IsTemplate:
            continue

        # 平面図(FloorPlan) に限定
        if v.ViewType != ViewType.FloorPlan:
            continue

        # GenLevel が入力レベルと一致するビューだけ残す
        gl = getattr(v, "GenLevel", None)
        if gl is None:
            continue
        if gl.Id != level_id:
            continue

        # 部屋・ドアカテゴリが可視
        if not categories_visible(v):
            continue

        valid.append(v)

    # Id 昇順で安定化し、先頭のみ採用
    if valid:
        valid.sort(key=lambda x: x.Id.IntegerValue)
        candidate = valid[0]

OUT = candidate
# ----------------------------------------

# group: 部屋
# 説明<グループの説明を編集するにはここをダブル クリック>
categories = Categories("OST_Rooms")
all_elements_of_category_in_view = ElementsOfCategoryInView(Category=categories, View=python_script)

近接中心性のパラメーター名 = StringInput("近接中心性")  # graph input
次数中心性のパラメーター名 = StringInput("次数中心性")  # graph input

# group: 部屋に入力されている近接中心性と次数中心性を空にする
# 説明<グループの説明を編集するにはここをダブル クリック>
code_block = CodeBlock { 99; }
setParameterByName = Element.SetParameterByName(element=all_elements_of_category_in_view, parameterName=近接中心性のパラメーター名, value=code_block)
setParameterByName_2 = Element.SetParameterByName(element=all_elements_of_category_in_view, parameterName=次数中心性のパラメーター名, value=code_block)

# group: 部屋に入力されている近接中心性と次数中心性を空になったら次に進む
# 説明<グループの説明を編集するにはここをダブル クリック>
code_block_2 = CodeBlock(x=setParameterByName, y=setParameterByName_2) { List.Count(x)==List.Count(y); }
code_block_3 = CodeBlock { null; }
if_ = RefactoredIf(test=code_block_2, true=all_elements_of_category_in_view, false=code_block_3)

# group: 部屋から部屋境界線で隣り合う部屋の組み合わせを抽出する
# 結論：使用可能
python_script_2 = Python(IN[0]=if_)  # CPython3
# ---------- python_script_2.python (267 lines) ----------
# Dynamo Python (CPython3) – Adjacent Room Pairs from Rooms
# RSL-only sampling + Wall-overlap exclusion (Revit 2024)

import clr, math
clr.AddReference('RevitAPI')
clr.AddReference('RevitServices')

from Autodesk.Revit.DB import *
from RevitServices.Persistence import DocumentManager

doc = DocumentManager.Instance.CurrentDBDocument
ZAXIS = XYZ.BasisZ

# ---------- 単位 ----------
def mm_to_internal(mm):
    return UnitUtils.ConvertToInternalUnits(mm, UnitTypeId.Millimeters)

# ---------- パラメータ（既定値） ----------
offset_mm      = 350.0
sample_step_mm = 500.0
overlap_pad_mm = 30.0   # 壁重なり許容（±mm）
parallel_tol_deg = 10.0 # 平行判定

if 'IN' in globals():
    if len(IN) >= 2 and IN[1] is not None:
        try: offset_mm = float(IN[1])
        except: pass
    if len(IN) >= 3 and IN[2] is not None:
        try: sample_step_mm = float(IN[2])
        except: pass

OFFSET      = mm_to_internal(offset_mm)
STEP        = mm_to_internal(sample_step_mm)
BB_PAD      = mm_to_internal(400.0)
OVERLAP_PAD = mm_to_internal(overlap_pad_mm)
COS_TOL     = math.cos(math.radians(parallel_tol_deg))

# ---------- ユーティリティ ----------
def to_db(elem):
    api = getattr(elem, 'InternalElement', None)
    if api: return api
    try:
        return UnwrapElement(elem)
    except:
        return elem

def is_room(e):
    try:
        return isinstance(e, SpatialElement) and e.Category and \
               e.Category.Id.IntegerValue == int(BuiltInCategory.OST_Rooms)
    except:
        return False

def norm_vec(v):
    if not v or v.GetLength() < 1e-12:
        return XYZ.BasisX
    return v.Normalize()

def tangent_xy(curve, param, normalized=False):
    try:
        deriv = curve.ComputeDerivatives(param, normalized)
        tvec  = norm_vec(deriv.BasisX)
    except:
        p0, p1 = curve.GetEndPoint(0), curve.GetEndPoint(1)
        tvec = norm_vec(p1.Subtract(p0))
    return tvec

def normal_xy_from_tangent(tvec):
    n = ZAXIS.CrossProduct(tvec)
    return norm_vec(n) if n.GetLength() >= 1e-12 else XYZ.BasisX

def expand_bbox_xy(bb, pad):
    if bb is None: return None
    mn, mx = bb.Min, bb.Max
    mn2 = XYZ(mn.X - pad, mn.Y - pad, mn.Z)
    mx2 = XYZ(mx.X + pad, mx.Y + pad, mx.Z)
    bb2 = BoundingBoxXYZ(); bb2.Min = mn2; bb2.Max = mx2
    return bb2

def bbox2d_contains(bb, pt):
    if bb is None: return True
    mn, mx = bb.Min, bb.Max
    x, y = pt.X, pt.Y
    return (mn.X <= x <= mx.X) and (mn.Y <= y <= mx.Y)

def candidate_rooms(pt, room_bbs):
    return [r for (r, bb) in room_bbs if bbox2d_contains(bb, pt)]

def room_at_point_prefiltered(pt, room_bbs):
    for r in candidate_rooms(pt, room_bbs):
        try:
            if r.IsPointInRoom(pt):
                return r
        except: pass
    return None

# 弧長 STEP ピッチでサンプリング
def length_uniform_samples(curve, step_len):
    pts = []
    poly = curve.Tessellate()
    if not poly or len(poly) < 2:
        try: pts.append(curve.Evaluate(0.5, True))
        except: pass
        return pts

    cum = [0.0]
    for i in range(1, len(poly)):
        seg_len = poly[i].DistanceTo(poly[i-1])
        cum.append(cum[-1] + seg_len)
    total = cum[-1]
    if total < 1e-8:
        try: pts.append(curve.Evaluate(0.5, True))
        except: pass
        return pts

    n = max(1, int(total / step_len))
    targets = [total * (k / float(n + 1)) for k in range(1, n + 1)]

    j = 1
    for d in targets:
        while j < len(cum) and cum[j] < d:
            j += 1
        if j >= len(cum): break
        d0, d1 = cum[j-1], cum[j]
        t = 0.5 if (d1 - d0) < 1e-12 else (d - d0) / (d1 - d0)
        vec = poly[j].Subtract(poly[j-1])
        p = poly[j-1].Add(vec.Multiply(t))
        pts.append(p)

    if not pts:
        try: pts.append(curve.Evaluate(0.5, True))
        except: pass
    return pts

# ---------- 壁データ ----------
def wall_half_thickness(wall):
    try:
        wt = wall.WallType
        if wt: return 0.5 * float(wt.Width)
    except: pass
    try:
        p = wall.WallType.get_Parameter(BuiltInParameter.WALL_ATTR_WIDTH_PARAM)
        if p: return 0.5 * float(p.AsDouble())
    except: pass
    return mm_to_internal(50.0)

walls = list(FilteredElementCollector(doc).OfClass(Wall).WhereElementIsNotElementType())
walls_data = []
for w in walls:
    try:
        loc = w.Location
        if isinstance(loc, LocationCurve):
            c = loc.Curve
            if c and c.Length > 1e-6:
                walls_data.append((w, c, wall_half_thickness(w)))
    except: pass

def is_overlapped_with_wall(pm, rsl_tangent, walls_data):
    for w, wc, half_t in walls_data:
        prj = wc.Project(pm)
        if not prj: 
            continue
        q = prj.XYZPoint
        dx = pm.X - q.X; dy = pm.Y - q.Y
        dist_xy = (dx*dx + dy*dy) ** 0.5
        if dist_xy > (half_t + OVERLAP_PAD):
            continue
        w_tan = tangent_xy(wc, prj.Parameter, normalized=False)
        if abs(rsl_tangent.DotProduct(w_tan)) >= COS_TOL:
            return True
    return False

# ---------- 入力の Rooms ----------
rooms_input = None
if 'IN' in globals() and len(IN) >= 1 and IN[0] is not None:
    elems_in = IN[0] if isinstance(IN[0], list) else [IN[0]]
    rooms_input = [to_db(e) for e in elems_in if e is not None]

if rooms_input and all(is_room(r) for r in rooms_input):
    rooms = rooms_input
else:
    rooms = list(
        FilteredElementCollector(doc)
        .OfCategory(BuiltInCategory.OST_Rooms)
        .WhereElementIsNotElementType()
    )

# ---------- 近傍探索用に Room の膨張BBox ----------
room_bbs = []
for r in rooms:
    try:
        bb = r.get_BoundingBox(None)
        bb = expand_bbox_xy(bb, BB_PAD) if bb else None
    except:
        bb = None
    room_bbs.append((r, bb))

# ---------- メイン（RSLのみを対象） ----------
opt = SpatialElementBoundaryOptions()
opt.SpatialElementBoundaryLocation = SpatialElementBoundaryLocation.Finish

pair_flags = {}  # key -> {"clean":bool, "dirty":bool}

def mark_pair(a, b, clean_sample):
    ida = a.Id.IntegerValue; idb = b.Id.IntegerValue
    key = (ida, idb) if ida < idb else (idb, ida)
    flags = pair_flags.get(key, {"clean": False, "dirty": False})
    if clean_sample: flags["clean"] = True
    else:            flags["dirty"] = True
    pair_flags[key] = flags

for rm in rooms:
    segloops = rm.GetBoundarySegments(opt)
    if not segloops: 
        continue

    for loop in segloops:
        for seg in loop:
            # ★ ここで RSL（部屋分割線）以外の境界は完全に除外 ★
            eid = seg.ElementId
            if not eid or eid == ElementId.InvalidElementId:
                continue
            host = doc.GetElement(eid)
            if not isinstance(host, CurveElement):
                continue
            cat = host.Category
            if not cat or cat.Id.IntegerValue != int(BuiltInCategory.OST_RoomSeparationLines):
                continue

            # RSL の実曲線で判定
            c = seg.GetCurve() if hasattr(seg, "GetCurve") else getattr(seg, "Curve", None)
            if c is None or c.Length < 1e-8:
                continue

            for pm in length_uniform_samples(c, STEP):
                prj = c.Project(pm)
                tparam = prj.Parameter if prj else 0.5
                tvec = tangent_xy(c, tparam, normalized=False)
                nvec = normal_xy_from_tangent(tvec)

                pL = pm.Add(nvec.Multiply(OFFSET))
                pR = pm.Add(nvec.Negate().Multiply(OFFSET))

                left  = room_at_point_prefiltered(pL, room_bbs)
                right = room_at_point_prefiltered(pR, room_bbs)

                # rm と向かい合う相手が見つかった場合のみ、壁重なりを評価
                if left is rm and right is not None and right.Id != rm.Id:
                    overlapped = is_overlapped_with_wall(pm, tvec, walls_data)
                    mark_pair(rm, right, clean_sample=(not overlapped))
                elif right is rm and left is not None and left.Id != rm.Id:
                    overlapped = is_overlapped_with_wall(pm, tvec, walls_data)
                    mark_pair(rm, left, clean_sample=(not overlapped))

# ---------- 出力 ----------
pairs = []
for (ida, idb), flags in pair_flags.items():
    if flags.get("clean", False):  # RSL単独で接している点が1箇所でもある
        a = doc.GetElement(ElementId(ida))
        b = doc.GetElement(ElementId(idb))
        if a and b:
            pairs.append([a, b])

if not pairs:
    pairs = [[None, None]]

OUT = pairs
# ----------------------------------------
name = Room.Name(room=python_script_2)

部屋分割線の重み = DoubleInput(1)  # graph input

# group: 部屋分割線による部屋のペアに重みを入力する。
count = List.Count(list=python_script_2)
cycle = List.Cycle(list=部屋分割線の重み, amount=count)
addItemToEnd = List.AddItemToEnd(item=cycle@L1, list=python_script_2@L2)

# group: ドア
# 説明<グループの説明を編集するにはここをダブル クリック>
categories_2 = Categories("OST_Doors")
all_elements_of_category_in_view_2 = ElementsOfCategoryInView(Category=categories_2, View=python_script)

扉の重み_交通コスト_のパラメーター名 = StringInput("交通コスト")  # graph input

# group: 建具を入力してつなぐ部屋(ペアと重み)を出力する。 重複するものやnullが含まれるものは削除する。
# ・[部屋1, 部屋2, 重み1], [部屋1, 部屋2, 重み1] →[部屋1, 部屋2, 重み1]の1つだけにする。
#  ・[部屋1, 部屋2, 重み1], [部屋1, 部屋2, 重み2] →[部屋1, 部屋2, 重み1], [部屋1, 部屋2, 重み2]の2つとも残す。
python_script_3 = Python(IN[0]=all_elements_of_category_in_view_2, IN[1]=扉の重み_交通コスト_のパラメーター名)  # CPython3
# ---------- python_script_3.python (179 lines) ----------
# -*- coding: utf-8 -*-

import clr

# Revit / Dynamo API 参照
clr.AddReference("RevitServices")
from RevitServices.Persistence import DocumentManager

clr.AddReference("RevitAPI")
from Autodesk.Revit.DB import BuiltInParameter, StorageType

# --- Python2/3 互換ユーティリティ ---
try:
    basestring
except NameError:
    basestring = str
try:
    unicode
except NameError:
    unicode = str
try:
    long
except NameError:
    long = int

# --- 入力 ---
doors = UnwrapElement(IN[0])  # 単体 or リストどちらでも可
param_name = IN[1] if len(IN) > 1 else None  # ① 重みを取るパラメーター名（ドア側）

# --- ActiveView のフェーズを明示取得（精度向上） ---
doc = DocumentManager.Instance.CurrentDBDocument
av = doc.ActiveView
phase_param = av.get_Parameter(BuiltInParameter.VIEW_PHASE)
phase = doc.GetElement(phase_param.AsElementId()) if phase_param else None

# --- 入力を反復可能に正規化 ---
seq = doors if isinstance(doors, (list, tuple)) else [doors]

# --- From/ToRoom 取得（例外非使用・属性存在チェックで分岐） ---
def get_rooms(inst):
    """FamilyInstance から [FromRoom, ToRoom] を返す。取得不可は None。"""
    if inst is None:
        return [None, None]

    # RevitAPI のメソッドがあれば優先（フェーズを明示して精度確保）
    if hasattr(inst, "get_FromRoom") and hasattr(inst, "get_ToRoom") and phase is not None:
        fr = inst.get_FromRoom(phase)
        tr = inst.get_ToRoom(phase)
        return [fr, tr]

    # フォールバック：Dynamo 側の簡易プロパティ
    fr = inst.FromRoom if hasattr(inst, "FromRoom") else None
    tr = inst.ToRoom if hasattr(inst, "ToRoom") else None
    return [fr, tr]

# --- Room -> 安定なID（None対応） ---
def room_id(r):
    return None if r is None else r.Id.IntegerValue

# --- ドアのパラメーター値（重み）取得：インスタンス優先→タイプ ---
def get_param_value(inst, name):
    if not name or inst is None:
        return None

    p = None
    try:
        if hasattr(inst, "LookupParameter"):
            p = inst.LookupParameter(name)
    except:
        p = None

    if p is None:
        # タイプ（FamilySymbol）側も検索
        try:
            tid = inst.GetTypeId() if hasattr(inst, "GetTypeId") else None
            if tid:
                typ = doc.GetElement(tid)
                if typ and hasattr(typ, "LookupParameter"):
                    p = typ.LookupParameter(name)
        except:
            p = None

    if p is None:
        return None

    # 値をStorageTypeに応じて取得
    try:
        st = p.StorageType
        if st == StorageType.Double:
            # 数値（内部単位）。表示単位で欲しい場合は次行に切替：
            # return p.AsValueString()
            return p.AsDouble()
        elif st == StorageType.Integer:
            return p.AsInteger()
        elif st == StorageType.String:
            s = p.AsString()
            if s is None or s == "":
                s = p.AsValueString()  # フォールバック
            return s
        elif st == StorageType.ElementId:
            eid = p.AsElementId()
            try:
                return None if eid is None or eid.IntegerValue < 0 else eid.IntegerValue
            except:
                return None
        else:
            try:
                return p.AsValueString()
            except:
                return None
    except:
        try:
            return p.AsValueString()
        except:
            return None

# --- 重みの正規化キー（重複判定用） ---
def weight_key(value):
    # Noneはそのまま
    if value is None:
        return ("NONE", None)
    # 整数
    if isinstance(value, int) or isinstance(value, long):
        return ("I", int(value))
    # 浮動小数（多少の誤差を抑えてキー化）
    try:
        if isinstance(value, float):
            return ("D", round(value, 8))
    except:
        pass
    # 文字列ほか
    try:
        return ("S", unicode(value))
    except:
        return ("S", str(value))

# --- 生トリプル生成：[From, To, 重み] ---
raw = []
for d in seq:
    fr, tr = get_rooms(d)
    w = get_param_value(d, param_name)
    raw.append([fr, tr, w])

# --- 整理ルール ---
# 1) None を含む部屋は除去
# 2) 同じ部屋同士 [x, x] は除去
# 3) [A,B, w] と [B,A, w] は同一扱いで重複除去（最初の向きを残す）
# 4) ③ 重みが違えば同じ部屋ペアでも残す
unique = []
seen = set()  # key = (min(idA,idB), max(idA,idB), weight_key)

for fr, tr, w in raw:
    ida, idb = room_id(fr), room_id(tr)

    # 1) None を含む → スキップ
    if ida is None or idb is None:
        continue
    # 2) 同一室ペア → スキップ
    if ida == idb:
        continue

    # 3) 部屋の順序無視＋4) 重みもキーに含める
    wkey = weight_key(w)
    if ida <= idb:
        key = (ida, idb, wkey)
    else:
        key = (idb, ida, wkey)

    if key in seen:
        continue
    seen.add(key)

    # 向き（From/To）は最初の出現を維持
    unique.append([fr, tr, w])

# --- 出力（形状互換） ---
# ・リスト入力 → [[from, to, 重み], ...]（整理済み）
# ・単体入力   → [from, to, 重み] or []（条件を満たさない場合は空）
OUT = unique if isinstance(doors, (list, tuple)) else (unique[0] if unique else [])
# ----------------------------------------
name_2 = Room.Name(room=python_script_3)

# group: 隣接関係のリスト
python_script_4 = Python(IN[0]=addItemToEnd, IN[1]=python_script_3)  # CPython3
# ---------- python_script_4.python (54 lines) ----------
# -*- coding: utf-8 -*-
# Dynamo Python (Revit 2024 / CPython3)
# ① IN[0], IN[1] は [[部屋1, 部屋2, 実数], ...] 形式
# ② 2つを統合
# ③ 入力時と同じ形式で出力（重複は完全一致だけ排除）
# ④ 実数に None(null) または 0 を含む場合は OUT にエラー文字列を返す

def _to_hashable(x):
    """set用のキーにできないオブジェクトはreprにフォールバック"""
    try:
        hash(x)
        return x
    except TypeError:
        return repr(x)

# 入力の正規化（Noneなどが来た場合は空リスト扱い）
data_a = IN[0] if isinstance(IN[0], list) else []
data_b = IN[1] if isinstance(IN[1], list) else []

combined = list(data_a) + list(data_b)

# 重複排除（先勝ち・順序保持）
seen = set()
merged = []
for row in combined:
    # 仕様の行か確認
    if isinstance(row, (list, tuple)) and len(row) >= 3:
        r1, r2, v = row[0], row[1], row[2]
        key = (_to_hashable(r1), _to_hashable(r2), v)
        if key in seen:
            continue
        seen.add(key)
        # 出力は元の形式（list）を維持
        merged.append([r1, r2, v])
    else:
        # 想定外の形はreprベースで一応の重複排除のみ行い、そのまま通す
        key = ("__raw__", repr(row))
        if key not in seen:
            seen.add(key)
            merged.append(row)

# エラーチェック：実数が None(null) または 0 を含むか（0.0含む）
invalid_rows = []
for row in merged:
    if isinstance(row, (list, tuple)) and len(row) >= 3:
        val = row[2]
        if val is None or (isinstance(val, (int, float)) and val == 0):
            invalid_rows.append(row)

if invalid_rows:
    # ④ エラーは出力ポートに文字列で返す
    OUT = "エラー: 実数に null または 0 が含まれています。該当行: {}".format(invalid_rows)
else:
    OUT = merged
# ----------------------------------------

# group: 部屋の組合せから近接中心性を求める
# 説明<グループの説明を編集するにはここをダブル クリック>
python_script_5 = Python(IN[0]=python_script_4)  # CPython3
# ---------- python_script_5.python (170 lines) ----------
# -*- coding: utf-8 -*-

from collections import defaultdict
import heapq
import math

# ---------- 入力 ----------
# IN[0] : [[RoomA, RoomB, weight], [RoomC, RoomD, weight], ...]
pairs = IN[0] or []

# ---------- 設定 ----------
# "distance" : 実数は距離（大きいほど遠い）
# "similarity" : 実数は類似度・強さ（大きいほど近い）→距離として 1/value に変換
WEIGHT_MODE = "distance"   # ここを "similarity" に変えると 1/weight を距離として用います
WF_IMPROVED = True         # 非連結グラフ補正（Wasserman & Faust）を有効化

# ---------- Room -> 比較用キー（ハッシュ可能） ----------
def room_key(room):
    if room is None:
        return None
    rid = getattr(room, "Id", None)
    if rid is not None:
        iv = getattr(rid, "IntegerValue", None)
        if isinstance(iv, int):
            return iv
    uid = getattr(room, "UniqueId", None)
    if uid is not None:
        return str(uid)
    # 最後の保険
    return str(room)

# ---------- 入力から無向・重み付きエッジ集合を作成 ----------
# 同一ペアの重複は「最小距離」を採用。自己ループは除外。
# 内部的には frozenset({u, v}) をキーにして無向辺を表現。
edge_map = {}        # frozenset({u, v}) -> weight(距離)
key_to_room = {}     # 計算キー -> 代表Room（最初に見つけたオブジェクト）
nodes_set = set()

def _to_distance_value(val):
    # val を距離に正規化
    try:
        w = float(val)
    except Exception:
        return None
    if not math.isfinite(w):
        return None
    if WEIGHT_MODE == "distance":
        # 距離としてそのまま使用。負は無効、0は許容（ゼロ長エッジ）
        if w < 0:
            return None
        return w
    else:  # "similarity"
        # 類似度→距離に変換。0以下は無効。
        if w <= 0:
            return None
        return 1.0 / w

for p in pairs:
    # 形式チェック
    if not isinstance(p, (list, tuple)) or len(p) < 3:
        continue
    a, b, w_raw = p[0], p[1], p[2]
    if a is None or b is None:
        continue

    ka, kb = room_key(a), room_key(b)
    if ka is None or kb is None or ka == kb:
        # None や自己ループは除外
        continue

    # 代表オブジェクト（最初に見つけた方）を記録
    if ka not in key_to_room:
        key_to_room[ka] = a
    if kb not in key_to_room:
        key_to_room[kb] = b

    # 距離値に正規化
    dist_w = _to_distance_value(w_raw)
    if dist_w is None:
        continue

    # 無向エッジは frozenset で正規化し、既存があれば最小距離を採用
    ekey = frozenset((ka, kb))
    prev = edge_map.get(ekey)
    if prev is None or dist_w < prev:
        edge_map[ekey] = dist_w

    nodes_set.add(ka)
    nodes_set.add(kb)

# ---------- 隣接辞書（無向・重み付き） ----------
# adj[u] = {v: weight, ...}
adj = {k: {} for k in nodes_set}
for ekey, w in edge_map.items():
    u, v = tuple(ekey)
    # 双方向に登録
    adj[u][v] = w
    adj[v][u] = w

# ---------- 重み付き 近接中心性（Dijkstra 使用） ----------
def dijkstra_all_dist(start, adj_local):
    """start からの最短距離（重み＝距離）辞書を返す。到達不能は含めない。"""
    dist = {start: 0.0}
    pq = [(0.0, start)]
    while pq:
        d, u = heapq.heappop(pq)
        if d > dist[u]:
            continue
        for v, w in adj_local[u].items():
            nd = d + w
            dv = dist.get(v)
            if dv is None or nd < dv:
                dist[v] = nd
                heapq.heappush(pq, (nd, v))
    return dist

def closeness_centrality_weighted(adj_local, wf_improved=True):
    nodes = list(adj_local.keys())
    N = len(nodes)
    if N == 0:
        return {}

    C = {}
    if N == 1:
        # 単一ノード（エッジなし）の場合は 0
        only = nodes[0]
        C[only] = 0.0
        return C

    for s in nodes:
        # 孤立点（次数0）は 0
        if not adj_local[s]:
            C[s] = 0.0
            continue

        dist = dijkstra_all_dist(s, adj_local)
        reachable = len(dist)  # 自身を含む
        # 自身以外への距離の総和
        total = 0.0
        for n, d in dist.items():
            if n != s:
                total += d

        if reachable <= 1 or total <= 0.0:
            C[s] = 0.0
            continue

        # 基本の定義： (到達可能ノード数-1)/総距離
        score = (reachable - 1) / total

        # 非連結グラフ補正（Wasserman & Faust）
        if wf_improved and N > 1:
            score *= (reachable - 1) / (N - 1)

        C[s] = float(score)
    return C

# ---------- 計算 ----------
scores = closeness_centrality_weighted(adj, wf_improved=WF_IMPROVED)

# ---------- Room オブジェクトへ戻して見やすく整形 ----------
# [[Room, score], ...] をスコア降順で返す
result_list = []
for k, room in key_to_room.items():
    s = scores.get(k, 0.0)
    result_list.append([room, s])

result_list.sort(key=lambda z: z[1], reverse=True)

OUT = result_list
# ----------------------------------------

# group: 部屋に近接中心性の値を入力
# 説明<グループの説明を編集するにはここをダブル クリック>
code_block_4 = CodeBlock { 0; }
getItemAtIndex = List.GetItemAtIndex(list=python_script_5@L2, index=code_block_4)
code_block_5 = CodeBlock { 1; }
getItemAtIndex_2 = List.GetItemAtIndex(list=python_script_5@L2, index=code_block_5)
code_block_6 = CodeBlock { 1; }
code_block_7 = CodeBlock { 99; }

code_block_8 = CodeBlock { "(内部仕上表)除外"; }
getParameterValueByName = Element.GetParameterValueByName(element=getItemAtIndex, parameterName=code_block_8)

# group (continued): 部屋に近接中心性の値を入力
allIndicesOf = List.AllIndicesOf(list=getParameterValueByName, item=code_block_6)
count_2 = List.Count(list=allIndicesOf)
cycle_2 = List.Cycle(list=code_block_7, amount=count_2)
python_script_6 = Python(IN[0]=getItemAtIndex_2, IN[1]=allIndicesOf, IN[2]=cycle_2)  # CPython3
# ---------- python_script_6.python (16 lines) ----------
# -*- coding: utf-8 -*-

# 入力
lst = IN[0]                 # 元のリスト
indices = IN[1] or []      # 置換する index のリスト
items = IN[2] or []        # 置換後の item のリスト

# 元のリストをコピー（破壊的変更を避ける）
result = list(lst)

# index と item のペアでループ
for idx, val in zip(indices, items):
    if isinstance(idx, int) and 0 <= idx < len(result):
        result[idx] = val  # 置き換え

OUT = result
# ----------------------------------------
setParameterByName_3 = Element.SetParameterByName(element=getItemAtIndex, parameterName=近接中心性のパラメーター名, value=python_script_6)

code_block_9 = CodeBlock(x=setParameterByName_3) { List.Count(x)>0; }
code_block_10 = CodeBlock { null; }
if_2 = RefactoredIf(test=code_block_9, true=all_elements_of_category_in_view_2, false=code_block_10)
建具の取付場所_変数のパラメーター名 = StringInput("取付場所_変数")  # graph input

# group: 入力された建具の部屋計算ポイントの部屋の 近接中心性、もしくは次数中心性を比べて 取付場所_変数に変数を入力する。
# 部屋から　>　部屋へ　→　2
# 部屋から　<　部屋へ　→　1
# 空の場合　→　0
python_script_7 = Python(IN[0]=if_2, IN[1]=近接中心性のパラメーター名, IN[2]=次数中心性のパラメーター名, IN[3]=建具の取付場所_変数のパラメーター名)  # CPython3
# ---------- python_script_7.python (240 lines) ----------
# -*- coding: utf-8 -*-

import clr

# Dynamo / Revit API
clr.AddReference("RevitServices")
from RevitServices.Persistence import DocumentManager
from RevitServices.Transactions import TransactionManager

clr.AddReference("RevitNodes")
import Revit
clr.ImportExtensions(Revit.Elements)

clr.AddReference("RevitAPI")
from Autodesk.Revit.DB import BuiltInParameter, StorageType

# ===== 入力 =====
doors_in = UnwrapElement(IN[0])                           # ドア（単体 or リスト）
PARAM_NAME_SCORE  = IN[1]
    # ⑫ 可変：近接中心性
PARAM_NAME_DEGREE = IN[2]
     # ⑬ 可変：次数中心性
PARAM_NAME_OUTPUT = IN[3]
     #建具表の取付場所に対する変数のパラメーター名

doors = doors_in if isinstance(doors_in, (list, tuple)) else [doors_in]

# ===== 前処理：ActiveView のフェーズ（From/ToRoom取得の精度向上） =====
doc = DocumentManager.Instance.CurrentDBDocument
av = doc.ActiveView
phase_param = av.get_Parameter(BuiltInParameter.VIEW_PHASE)
phase = doc.GetElement(phase_param.AsElementId()) if phase_param else None

def get_rooms(inst):
    """ドア(FamilyInstance)から [FromRoom, ToRoom] を返す。取得不可は None。"""
    if inst is None:
        return [None, None]
    if hasattr(inst, "get_FromRoom") and hasattr(inst, "get_ToRoom") and phase is not None:
        return [inst.get_FromRoom(phase), inst.get_ToRoom(phase)]
    # フォールバック（Dynamo簡易プロパティ）
    fr = getattr(inst, "FromRoom", None)
    tr = getattr(inst, "ToRoom", None)
    return [fr, tr]

def parse_numeric_from_param(p):
    """
    Parameter から数値(float)を取得。
    未設定/取得不可は None を返す。
    """
    if p is None:
        return None
    try:
        st = p.StorageType
        if st == StorageType.Double:
            v = p.AsDouble()
            return None if v is None else float(v)
        elif st == StorageType.Integer:
            v = p.AsInteger()
            return None if v is None else float(v)
        elif st == StorageType.String:
            s = p.AsString()
            if s is None:
                return None
            s = s.strip()
            if s == "":
                return None
            s = s.replace(",", "").replace("，", "").replace("．", ".")
            try:
                return float(s)
            except:
                return None
        else:
            return None
    except:
        return None

def get_room_value(room, param_name):
    """Room 要素から param_name を Lookup し数値化して返す（なければ None）。"""
    if room is None:
        return None
    try:
        p = room.LookupParameter(param_name)
        return parse_numeric_from_param(p)
    except:
        return None

def clear_output_param(elem, param_name):
    """
    ② 既存の「取付場所_変数」を削除（クリア）。
      - String型: 空文字
      - Integer/Double型: 0
    """
    if elem is None:
        return False
    p = elem.LookupParameter(param_name)
    if p is None or p.IsReadOnly:
        return False
    try:
        if p.StorageType == StorageType.String:
            return p.Set("")
        elif p.StorageType == StorageType.Integer:
            return p.Set(0)
        elif p.StorageType == StorageType.Double:
            return p.Set(0.0)
        else:
            return False
    except:
        return False

def set_output_param(elem, param_name, value):
    """
    ⑩ 判定値を書き込み。
    value が None（null）なら書き込まず、②でクリアした状態のままにする。
    """
    if elem is None or value is None:
        return False
    p = elem.LookupParameter(param_name)
    if p is None or p.IsReadOnly:
        return False
    try:
        if p.StorageType == StorageType.Integer:
            return p.Set(int(value))
        elif p.StorageType == StorageType.Double:
            return p.Set(float(value))
        elif p.StorageType == StorageType.String:
            return p.Set(str(int(value)))
        else:
            return False
    except:
        return False

def same_room(fr, to):
    """
    FromRoom / ToRoom が同一か判定（⑧）。
    ElementId で比較。どちらか None の場合は False。
    """
    if fr is None or to is None:
        return False
    try:
        return fr.Id == to.Id
    except:
        return False

def decide_value(fr, to, fr_score, to_score, fr_degree, to_degree):
    """
    ③〜⑨の判定ロジックを実装して値を返す。
      1: To側優先
      2: From側優先
      3: 同値（同点）
      0: 両方 None（⑨）
      None: null（⑥）
    優先順位（安全側で早期判定）:
      A) ⑨ 両方の部屋が None → 0
      B) ⑧ 同一室 → 1
      C) ⑥ 近接中心性が両方 None → None
      D) ④ Fromのみ近接中心性あり → 1
      E) ⑤ Toのみ近接中心性あり   → 2
      F) ③ 近接中心性を比較（From>To→2, To>From→1, 同点→Gへ）
      G) ⑥（同点時）次数中心性で比較（From>To→2, To>From→1, 同点/欠損→Hへ）
      H) ⑦ フォールバック：部屋の存在で決定（Fromのみ→1, Toのみ→2, 両方→1）
    """
    # A) ⑨ 両方 None
    if fr is None and to is None:
        return 0

    # B) ⑧ 同一室
    if same_room(fr, to):
        return 1

    # C) ⑥ 近接中心性が両方 None（null）
    if fr_score is None and to_score is None:
        return None

    # D) ④ Fromのみ入力
    if fr_score is not None and to_score is None:
        return 1

    # E) ⑤ Toのみ入力
    if fr_score is None and to_score is not None:
        return 2

    # F) ③ 両方あり：近接中心性で大小比較
    if fr_score is not None and to_score is not None:
        if fr_score > to_score:
            return 2
        elif fr_score < to_score:
            return 1
        # 同点 → 次数中心性比較へ

    # G) ⑥（同点時）次数中心性で比較
    if fr_degree is not None and to_degree is not None:
        if fr_degree > to_degree:
            return 2
        elif fr_degree < to_degree:
            return 1
        else:
            # 完全同点 → フォールバックへ
            pass
    elif fr_degree is not None and to_degree is None:
        # Fromのみ次数中心性があるが、仕様上ここで確定指示は無いのでフォールバックへ
        pass
    elif fr_degree is None and to_degree is not None:
        # Toのみ次数中心性があるが、仕様上ここで確定指示は無いのでフォールバックへ
        pass

    # H) ⑦ フォールバック：From/To の「存在」で判定
    if fr is not None and to is None:
        return 1
    if fr is None and to is not None:
        return 2
    # 両方存在する場合は 1 を返す（タイブレーク）
    return 1

results = []

TransactionManager.Instance.EnsureInTransaction(doc)
for d in doors:
    # ② 既存「取付場所_変数」を削除（クリア）
    clear_output_param(d, PARAM_NAME_OUTPUT)

    # From / To 取得
    fr, to = get_rooms(d)

    # 近接中心性・次数中心性の値取得
    fr_score  = get_room_value(fr, PARAM_NAME_SCORE)
    to_score  = get_room_value(to, PARAM_NAME_SCORE)
    fr_degree = get_room_value(fr, PARAM_NAME_DEGREE)
    to_degree = get_room_value(to, PARAM_NAME_DEGREE)

    # ③〜⑨ 判定
    decided = decide_value(fr, to, fr_score, to_score, fr_degree, to_degree)

    # ⑩ パラメーターへ書き込み（None は書き込まずクリア状態を維持）
    set_output_param(d, PARAM_NAME_OUTPUT, decided)

    results.append(decided)
TransactionManager.Instance.TransactionTaskDone()

# 出力：単体入力は単体、リスト入力はリスト
OUT = results if isinstance(doors_in, (list, tuple)) else (results[0] if results else None)
# ----------------------------------------

python_script_8 = Python(IN[0]=python_script_4)  # CPython3
# ---------- python_script_8.python (118 lines) ----------
# -*- coding: utf-8 -*-

from collections import defaultdict
import math

# ---------- 入力 ----------
# IN[0] : [[RoomA, RoomB, weight], [RoomC, RoomD, weight], ...]
triples = IN[0] or []

# ---------- Room -> 比較用キー（ハッシュ可能） ----------
def room_key(room):
    """
    Revit/Dynamo の Room オブジェクトから安定したハッシュキーを作る。
    Id.IntegerValue があればそれを、なければ UniqueId（文字列）、最後の保険で文字列化。
    """
    if room is None:
        return None
    rid = getattr(room, "Id", None)
    if rid is not None:
        iv = getattr(rid, "IntegerValue", None)
        if isinstance(iv, int):
            return iv
    uid = getattr(room, "UniqueId", None)
    if uid is not None:
        return str(uid)
    return str(room)

def canonical_pair(a, b):
    """
    エッジ（無向）の正規化されたペア表現を返す。
    型混在での比較エラーを避けるため、比較は try/except でフォールバック。
    """
    try:
        return (a, b) if a <= b else (b, a)
    except Exception:
        sa, sb = str(a), str(b)
        return (a, b) if sa <= sb else (b, a)

# ---------- エッジ集合（重み付き・無向）を構築（自己ループ・不正重みを除去） ----------
# edge_weights: { (u,v): summed_weight }  ※(u,v) は canonical_pair
edge_weights = {}
key_to_room = {}

for item in triples:
    if not isinstance(item, (list, tuple)) or len(item) < 3:
        continue
    r1, r2, w = item[0], item[1], item[2]

    if r1 is None or r2 is None:
        continue

    # 重みを検証・正規化（非数/非有限/<=0 は無視）
    try:
        w = float(w)
    except Exception:
        continue
    if not math.isfinite(w) or w <= 0.0:
        continue

    k1, k2 = room_key(r1), room_key(r2)
    if k1 is None or k2 is None or k1 == k2:
        continue  # 自己ループやキー不明は除外

    if k1 not in key_to_room:
        key_to_room[k1] = r1
    if k2 not in key_to_room:
        key_to_room[k2] = r2

    e = canonical_pair(k1, k2)
    prev = edge_weights.get(e)
    if prev is None:
        edge_weights[e] = w
    else:
        edge_weights[e] = prev + w  # 同一ペアは重みを合算

# 早期終了（エッジなし）
if not edge_weights:
    OUT = []
else:
    # ---------- 隣接集合と strength（加重次数）を同時に構築 ----------
    neighbors = defaultdict(set)      # { node: {neighbor, ...} }
    strength  = defaultdict(float)    # { node: sum_of_weights }
    nodes_set = set()

    # 最大エッジ重み（正規化用）
    max_w = 0.0
    for (u, v), w in edge_weights.items():
        neighbors[u].add(v)
        neighbors[v].add(u)
        strength[u] += w
        strength[v] += w
        nodes_set.add(u); nodes_set.add(v)
        if w > max_w:
            max_w = w

    n = len(nodes_set)
    denom = (n - 1) * max_w if (n > 1 and max_w > 0.0) else None

    # ---------- Room オブジェクトへ戻して整形（スコア降順） ----------
    result_list = []
    if denom is None:
        # ノード1個以下 or 有効重みなし → スコアは 0
        for k in nodes_set:
            room = key_to_room.get(k, None)
            deg = len(neighbors.get(k, ()))
            result_list.append([room, 0.0, deg])
    else:
        for k in nodes_set:
            room = key_to_room.get(k, None)
            deg = len(neighbors.get(k, ()))
            s   = strength.get(k, 0.0)
            norm_score = s / denom  # 0.0〜1.0（理論上は deg/(n-1) を上限）
            result_list.append([room, norm_score, deg])

    # スコア降順で安定ソート（同点は隣接数降順→キー昇順相当で軽く安定化）
    result_list.sort(key=lambda z: (z[1], z[2]), reverse=True)

    OUT = result_list
# ----------------------------------------

# group: 部屋に次数中心性の値を入力
# 説明<グループの説明を編集するにはここをダブル クリック>
code_block_11 = CodeBlock { 0; }
getItemAtIndex_3 = List.GetItemAtIndex(list=python_script_8@L2, index=code_block_11)
code_block_12 = CodeBlock { 2; }
getItemAtIndex_4 = List.GetItemAtIndex(list=python_script_8@L2, index=code_block_12)
setParameterByName_4 = Element.SetParameterByName(element=getItemAtIndex_3, parameterName=次数中心性のパラメーター名, value=getItemAtIndex_4)

# group: Dynamoプレイヤー出力用
# 説明<グループの説明を編集するにはここをダブル クリック>
code_block_13 = CodeBlock { 0; }
getItemAtIndex_5 = List.GetItemAtIndex(list=python_script_4@L2, index=code_block_13)
code_block_14 = CodeBlock { 1; }
getItemAtIndex_6 = List.GetItemAtIndex(list=python_script_4@L2, index=code_block_14)
code_block_15 = CodeBlock { 2; }
getItemAtIndex_7 = List.GetItemAtIndex(list=python_script_4@L2, index=code_block_15)
python_script_9 = Python(IN[0]=getItemAtIndex_5, IN[1]=getItemAtIndex_6, IN[2]=getItemAtIndex_7)  # CPython3
# ---------- python_script_9.python (14 lines) ----------
# Python 標準ライブラリおよび DesignScript ライブラリをロード
import sys
import clr
clr.AddReference('ProtoGeometry')
from Autodesk.DesignScript.Geometry import *


result = []
for (r1, r2, k) in zip(IN[0], IN[1], IN[2]):
    r1_name = r1.Name
    r2_name = r2.Name
    set = [r1_name, r2_name, k]
    result.append(set)
OUT = result
# ----------------------------------------
隣接関係のリスト = Watch(python_script_9)  # graph output

python_script_10 = Python()  # CPython3; unwired: IN[0]; starter script, not edited (OUT = 0)
